# Grasshopper definition Waffle_System_Single_Surf.gh (Grasshopper 0.9.76)

geo = Geometry(<brep referenced from the Rhino model>)  # disabled
crv = Curve()  # disabled
offset = Offset(Curve=crv, Distance=Slider(0.2, range=0..1), Plane=PlaneXY(0, 0, 0), Corners=1)  # disabled
# [ Waffle Definition - Single Surface ]
# 
# NOTE: Please make this your own. Build
# on it and make it better.
ring_orientation = Slider(1, range=-1..1)
polar_rotation = Slider(360, range=0..360)
rib_height = Slider(0.5, range=0.1..5)
slot_cut_depth = Slider(0.177, range=0..1)
x_grid_spacing = Slider(23, range=0..50)
y_grid_spacing = Slider(18, range=0..50)
horizontal_num = Slider(8, range=2..20)
polar_num = Slider(3, range=2..20)
material_thickness = Slider(0.121, range=0.001..1.002)
geo_2 = Geometry(<brep referenced from the Rhino model>)

# ----
# Model Parameters
rib_height_2 = Slider(0.4, range=-20..20)  # disabled
material_thickness_2 = Slider(0.2, range=0.1..4)  # disabled
label_size = Slider(3.169, range=0.1..10)  # disabled
output_curve_spacing = Slider(12, range=1..500)  # disabled
y_num_divisions = Slider(7, range=2..20)  # disabled
x_num_divisions = Slider(7, range=2..20)  # disabled
srf = Surface()  # disabled

bbox = BoundingBox(Content=geo_2, Plane=PlaneXY(0, 0, 0))  # -> Box, Box_2
box_corners = BoxCorners(Box=bbox.Box)  # -> CornerA, CornerB, CornerC, CornerD, CornerE, CornerF, CornerG, CornerH
rad = Radians(Degrees=polar_rotation)
bottom_pt_1 = Point(box_corners.CornerA)
bottom_pt_2 = Point(box_corners.CornerB)
bottom_pt_3 = Point(box_corners.CornerC)
bottom_pt_4 = Point(box_corners.CornerD)

# ----
# Create bounding box and extract
# corners of box to build a base surface
# in both x and y directions.
bbox_2 = BoundingBox(Content=srf, Plane=PlaneXY(0, 0, 0))  # -> Box, Box_2; disabled
box_corners_2 = BoxCorners(Box=bbox_2.Box)  # -> CornerA, CornerB, CornerC, CornerD, CornerE, CornerF, CornerG, CornerH; disabled
bottom_pt1 = Point(box_corners_2.CornerA)  # disabled
bottom_pt2 = Point(box_corners_2.CornerB)  # disabled
bottom_pt3 = Point(box_corners_2.CornerC)  # disabled
bottom_pt4 = Point(box_corners_2.CornerD)  # disabled
top_pt3 = Point(box_corners_2.CornerG)  # disabled
top_pt1 = Point(box_corners_2.CornerE)  # disabled
top_pt4 = Point(box_corners_2.CornerH)  # disabled
top_pt2 = Point(box_corners_2.CornerF)  # disabled
x_surface = _4PointSurface(CornerA=bottom_pt1, CornerB=bottom_pt2, CornerC=top_pt2, CornerD=top_pt1)  # disabled
y_surface = _4PointSurface(CornerA=bottom_pt2, CornerB=bottom_pt3, CornerC=top_pt3, CornerD=top_pt2)  # disabled

pt = Point(box_corners.CornerH)
ln = Line(StartPoint=box_corners.CornerE, EndPoint=box_corners.CornerG)
ln_2 = Line(StartPoint=box_corners.CornerF, EndPoint=box_corners.CornerH)
topintersection = LineLine(Line1=ln, Line2=ln_2)  # -> ParamA, ParamB, PointA, PointB
srf4pt = _4PointSurface(CornerA=bottom_pt_1, CornerB=bottom_pt_2, CornerC=bottom_pt_3, CornerD=bottom_pt_4)
z_dist = Distance(PointA=pt, PointB=bottom_pt_4)
bottom_corner = Point(Point(7, 0, 0))
bottom_center = Point(Point(0, 0, 21.65401429))
top_corner = Point(Point(7, 0, 19))
top_center = Point(topintersection.PointA)
division = Division(A=z_dist, B=horizontal_num)
division_2 = Division(A=z_dist, B=horizontal_num)
ln_3 = Line(StartPoint=bottom_pt_1, EndPoint=bottom_pt_3)
ln_4 = Line(StartPoint=bottom_pt_2, EndPoint=bottom_pt_4)

# ----
# Move and copy surfaces along the
# x-axis at a specified spacing interval.
y_dist = Distance(PointA=bottom_pt2, PointB=bottom_pt3)  # disabled
division_3 = Division(A=y_dist, B=y_num_divisions)  # disabled
division_4 = Division(A=y_dist, B=y_num_divisions)  # disabled
division_5 = Division(A=division_4, B=2)  # disabled
series = Series(Start=division_5, Step=division_3, Count=y_num_divisions)  # disabled
Y = UnitY(Factor=series)  # disabled
x_planes = Move(Geometry=x_surface, Motion=Y)  # -> Geometry, Transform; disabled

# ----
# Move and copy surfaces along the
# x-axis.
x_dist = Distance(PointA=bottom_pt1, PointB=bottom_pt2)  # disabled
division_6 = Division(A=x_dist, B=x_num_divisions)  # disabled
division_7 = Division(A=division_6, B=2)  # disabled
series_2 = Series(Start=division_7, Step=division_6, Count=x_num_divisions)  # disabled
X = UnitX(Factor=expr("-x", series_2))  # disabled
y_planes = Move(Geometry=y_surface, Motion=X)  # -> Geometry, Transform; disabled

bottom_intersection = LineLine(Line1=ln_3, Line2=ln_4)  # -> ParamA, ParamB, PointA, PointB
bottom_center_2 = Point(bottom_intersection.PointA)
series_3 = Series(Start=division, Step=division_2, Count=horizontal_num)

# ----
# Orient and Tagging Functions
# Create a series on numbers.
# Count = number of y struts.
# Spacing = output curve spacing
series_4 = Series(Start=0, Step=output_curve_spacing, Count=y_num_divisions)  # disabled

# ----
# Compute location of spacing for
# y struts labeling. Add to max y
# value of series for x strut
# labeling.
item = ListItem(List=series_4, Index=expr("x-1", y_num_divisions), Wrap=True)  # disabled
addition = Addition(A=item, B=output_curve_spacing)  # disabled
series_5 = Series(Start=addition, Step=output_curve_spacing, Count=x_num_divisions)  # disabled

number_slider = Slider(45, range=0..360)  # disabled
Z = UnitZ(Factor=expr("-x", 0.7))
Z_2 = UnitZ(Factor=series_3)
radial_surface = _4PointSurface(CornerA=bottom_center_2, CornerB=bottom_pt_2, CornerC=box_corners.CornerF, CornerD=top_center)
zplanes = Move(Geometry=srf4pt, Motion=Z_2)  # -> Geometry, Transform
bbx = BrepBrep(BrepA=geo_2, BrepB=radial_surface)  # -> Curves, Points
move = Move(Geometry=zplanes.Geometry, Motion=Z)  # -> Geometry, Transform

# ----
# Add a point and xy plane in at
# location in y-direction.
pt_2 = PointXYZ(XComponent=0, YComponent=series_5, ZComponent=0)  # disabled
xy = XYPlane(Origin=pt_2)  # disabled

division_8 = Division(A=rib_height, B=ring_orientation)
end = EndPoints(Curve=bbx.Curves)  # -> Start, End

# ----
# Add a point and xy plane in at
# location in y-direction.
pt_3 = PointXYZ(XComponent=0, YComponent=series_4, ZComponent=0)  # disabled
xy_2 = XYPlane(Origin=pt_3)  # disabled

bbx_2 = BrepBrep(BrepA=geo_2, BrepB=move.Geometry)  # -> Curves, Points
Z_3 = UnitZ(Factor=1)
vec2pt = Vector2Pt(PointA=bottom_center_2, PointB=end.End, Unitize=material_thickness)  # -> Vector, Length
offset_2 = Offset(Curve=bbx_2.Curves, Distance=division_8, Plane=PlaneXY(0, 0, 0), Corners=1)
Z_4 = UnitZ(Factor=expr("x", material_thickness))
Z_5 = UnitZ(Factor=expr("-x", material_thickness))
vec2pt_2 = Vector2Pt(PointA=bottom_center_2, PointB=end.Start, Unitize=material_thickness)  # -> Vector, Length
rad_2 = Radians(Degrees=Slider(90, range=0..360))

# ----
# Unit x vector
Z_6 = UnitZ(Factor=rib_height_2)  # disabled

vrot = Rotate(Vector=vec2pt_2.Vector, Axis=Z_3, Angle=rad_2)

# ----
# Create ribs in the y direction
bbx_3 = BrepBrep(A=srf, B=y_planes.Geometry)  # -> Curves, Points; disabled
extr = Extrude(Base=bbx_3.Curves, Direction=Z_6)  # disabled
wires = BrepWireframe(Brep=extr, Density=-1)  # disabled
X_2 = UnitX(Factor=expr("-x", material_thickness_2))  # disabled
X_3 = UnitX(Factor=expr("x/2", material_thickness_2))  # disabled
join = JoinCurves(Curves=wires, Preserve=False)  # disabled
move_2 = Move(Geometry=join, Motion=X_3)  # -> Geometry, Transform; disabled
extr_2 = Extrude(Base=move_2.Geometry, Direction=X_2)  # disabled
cap = CapHoles(Brep=extr_2)  # disabled

rulesrf = RuledSurface(CurveA=offset_2, CurveB=bbx_2.Curves)

# ----
# Create ribs in the x direction
# x/2
# -x
bbx_4 = BrepBrep(A=srf, B=x_planes.Geometry)  # -> Curves, Points; disabled
extr_3 = Extrude(Base=bbx_4.Curves, Direction=Z_6)  # disabled
wires_2 = BrepWireframe(Brep=extr_3, Density=-1)  # disabled
Y_2 = UnitY(Factor=expr("-x", material_thickness_2))  # disabled
Y_3 = UnitY(Factor=expr("x/2", material_thickness_2))  # disabled
join_2 = JoinCurves(Curves=wires_2, Preserve=False)  # disabled
move_3 = Move(Geometry=join_2, Motion=Y_3)  # -> Geometry, Transform; disabled
extr_4 = Extrude(Base=move_3.Geometry, Direction=Y_2)  # disabled
cap_2 = CapHoles(Brep=extr_4)  # disabled

amp = Amplitude(Vector=vec2pt_2.Vector, Amplitude=rib_height)
amp_2 = Amplitude(Vector=vrot, Amplitude=material_thickness)
move_4 = Move(Geometry=rulesrf, Motion=Z_4)  # -> Geometry, Transform

# ----
# Tag the ribs in the y direction
end_2 = EndPoints(Curve=bbx_3.Curves)  # -> Start, End; disabled
series_6 = Series(Start=1, Step=1, Count=x_num_divisions)  # disabled
pt_4 = Point(end_2.Start)  # disabled
eval = Evaluate(F="Format(\"Y strut:{0}\",x)", x=series_6)  # disabled
tag = TextTag3D(Location=flatten(pt_4), Text=eval, Size=label_size, Justification=7)  # disabled

# ----
# Orient points from x strut labeling
# to position on y-axis.
text_tag_location = Orient(Geometry=flatten(pt_4), Source=y_planes.Geometry, Target=xy)  # -> Geometry, Transform; disabled

# ----
# Create a series of numbers,
# 1 to n-number of y struts in
# the y-direction. Add a text tag
# to specified location.
series_7 = Series(Start=1, Step=1, Count=x_num_divisions)  # disabled
eval_2 = Evaluate(F="Format(\"Y strut:{0}\",x)", x=series_7)  # disabled
tag_2 = TextTag3D(Location=text_tag_location.Geometry, Text=eval_2, Size=label_size, Justification=7)  # disabled

# ----
# Tag the ribs in the x direction
end_3 = EndPoints(Curve=bbx_4.Curves)  # -> Start, End; disabled
pt_5 = Point(end_3.Start)  # disabled
series_8 = Series(Start=1, Step=1, Count=y_num_divisions)  # disabled
eval_3 = Evaluate(F="Format(\"X strut:{0}\",x)", x=series_8)  # disabled
tag_3 = TextTag3D(Location=flatten(pt_5), Text=eval_3, Size=label_size, Justification=7)  # disabled

# ----
# Orient points from x strut labeling
# to position on y-axis.
text_tag_location_2 = Orient(Geometry=flatten(pt_5), Source=x_planes.Geometry, Target=xy_2)  # -> Geometry, Transform; disabled

# ----
# Create a series of numbers,
# 1 to n-number of x struts in
# the y-direction. Add a text tag
# to specified location.
series_9 = Series(Start=1, Step=1, Count=y_num_divisions)  # disabled
eval_4 = Evaluate(F="Format(\"X strut:{0}\",x)", x=series_9)  # disabled
tag_4 = TextTag3D(Location=text_tag_location_2.Geometry, Text=eval_4, Size=label_size, Justification=7)  # disabled

extr_5 = Extrude(Base=bbx.Curves, Direction=amp)
vec2pt_3 = Vector2Pt(PointA=top_center, PointB=end.End, Unitize=False)  # -> Vector, Length
division_9 = Division(A=material_thickness, B=ring_orientation)
extr_6 = Extrude(Base=move_4.Geometry, Direction=Z_5)
move_5 = Move(Geometry=extr_5, Motion=amp_2)  # -> Geometry, Transform
neg = Negative(Value=amp_2)
neg_2 = Negative(Value=vec2pt_3.Vector)
cap_3 = CapHoles(Brep=extr_6)
extr_7 = Extrude(Base=move_5.Geometry, Direction=neg)
move_6 = Move(Geometry=extr_7, Motion=neg_2)  # -> Geometry, Transform
number_slider_2 = Slider(4, range=0..10)  # disabled
pt_6 = Point(bottom_pt3)  # disabled
series_10 = Series(Start=pt_6, Step=number_slider_2, Count=y_num_divisions)  # disabled
Y_4 = UnitY(Factor=series_10)  # disabled
move_7 = Move(Geometry=pt_6, Motion=Y_4)  # -> Geometry, Transform; disabled
orient = Orient(Geometry=join_2, Source=x_planes.Geometry, Target=move_7.Geometry)  # -> Geometry, Transform; disabled

ring_orientation_2 = Slider(1, range=-1..1)  # disabled
horizontal_num_2 = Slider(9, range=2..20)  # disabled
polar_num_2 = Slider(3, range=2..20)  # disabled
material_thickness_3 = Slider(0.117, range=0.001..1.002)  # disabled
rib_height_3 = Slider(2.9, range=0.1..5)  # disabled
slot_cut_depth_2 = Slider(0.177, range=0..1)  # disabled
x_grid_spacing_2 = Slider(23, range=0..50)  # disabled
y_grid_spacing_2 = Slider(18, range=0..50)  # disabled
polar_rotation_2 = Slider(360, range=0..360)  # disabled
number_slider_3 = Slider(11, range=0..20)  # disabled
X_4 = UnitX(Factor=number_slider_3)  # disabled

merge = Merge(Data1=geo)  # disabled
bbox_3 = BoundingBox(Content=merge, Plane=PlaneXY(0, 0, 0))  # -> Box, Box_2; disabled
box_corners_3 = BoxCorners(Box=bbox_3.Box_2)  # -> CornerA, CornerB, CornerC, CornerD, CornerE, CornerF, CornerG, CornerH; disabled
bottom_pt_4_2 = Point(box_corners_3.CornerD)  # disabled
bottom_pt_1_2 = Point(box_corners_3.CornerA)  # disabled
bottom_pt_3_2 = Point(box_corners_3.CornerC)  # disabled
bottom_pt_2_2 = Point(box_corners_3.CornerB)  # disabled
z_surface = _4PointSurface(CornerA=bottom_pt_1_2, CornerB=bottom_pt_2_2, CornerC=bottom_pt_3_2, CornerD=bottom_pt_4_2)  # disabled

pt_7 = Point(box_corners_3.CornerE)  # disabled
pt_8 = Point(box_corners_3.CornerG)  # disabled

ln_5 = Line(StartPoint=bottom_pt_2_2, EndPoint=bottom_pt_4_2)  # disabled
ln_6 = Line(StartPoint=bottom_pt_1_2, EndPoint=bottom_pt_3_2)  # disabled
llx = LineLine(Line1=ln_6, Line2=ln_5)  # -> ParamA, ParamB, PointA, PointB; disabled

ln_7 = Line(StartPoint=box_corners_3.CornerE, EndPoint=box_corners_3.CornerG)  # disabled
ln_8 = Line(StartPoint=box_corners_3.CornerF, EndPoint=box_corners_3.CornerH)  # disabled
llx_2 = LineLine(Line1=ln_7, Line2=ln_8)  # -> ParamA, ParamB, PointA, PointB; disabled

z_dist_2 = Distance(PointA=bottom_pt_3_2, PointB=pt_8)  # disabled

division_10 = Division(A=z_dist_2, B=horizontal_num_2)  # disabled
division_11 = Division(A=z_dist_2, B=horizontal_num_2)  # disabled
division_12 = Division(A=division_10, B=2)  # disabled
series_11 = Series(Start=division_12, Step=division_11, Count=horizontal_num_2)  # disabled
Z_7 = UnitZ(Factor=series_11)  # disabled
z_planes = Move(Geometry=z_surface, Motion=Z_7)  # -> Geometry, Transform; disabled
bbx_5 = BrepBrep(A=merge, B=z_planes.Geometry)  # -> Curves, Points; disabled

bottom_center_3 = Point(llx.PointA)  # disabled
bottom_corner_2 = Point(box_corners_3.CornerB)  # disabled
top_corner_2 = Point(box_corners_3.CornerF)  # disabled
top_center_2 = Point(llx_2.PointA)  # disabled
radial_surface_2 = _4PointSurface(CornerA=bottom_center_3, CornerB=bottom_corner_2, CornerC=top_corner_2, CornerD=top_center_2)  # disabled

ln_9 = Line(StartPoint=bottom_center_3, EndPoint=top_center_2)  # disabled

multiplication = Multiplication(A=rib_height_3, B=ring_orientation_2)  # disabled
offset_3 = Offset(Curve=bbx_5.Curves, Distance=multiplication, Plane=PlaneXY(0, 0, 0), Corners=1)  # disabled
rulesrf_2 = RuledSurface(CurveA=offset_3, CurveB=bbx_5.Curves)  # disabled
Z_8 = UnitZ(Factor=expr("x/2", material_thickness_3))  # disabled
Z_9 = UnitZ(Factor=expr("-x", material_thickness_3))  # disabled
move_8 = Move(Geometry=rulesrf_2, Motion=Z_8)  # -> Geometry, Transform; disabled
extr_8 = Extrude(Base=move_8.Geometry, Direction=Z_9)  # disabled
flatten = FlattenTree(Tree=extr_8, Path="{0}")  # disabled
cap_4 = CapHoles(Brep=extr_8)  # disabled

move_9 = Move(Geometry=llx.PointB, Motion=X_4)  # -> Geometry, Transform; disabled
grid_base_point = Point(move_9.Geometry)  # disabled

number_slider_4 = Slider(90, range=0..360)  # disabled
rad_3 = Radians(Degrees=number_slider_4)  # disabled
rad_4 = Radians(Degrees=polar_rotation_2)  # disabled
arrpolar = PolarArray(Geometry=radial_surface_2, Plane=PlaneXY(0, 0, 0), Count=polar_num_2, Angle=rad_4)  # -> Geometry, Transform; disabled
Z_10 = UnitZ(Factor=1)  # disabled
bbx_6 = BrepBrep(A=merge, B=arrpolar.Geometry)  # -> Curves, Points
end_4 = EndPoints(Curve=bbx_6.Curves)  # -> Start, End; disabled
vec2pt_4 = Vector2Pt(PointA=bottom_center_3, PointB=end_4.End, Unitize=material_thickness_3)  # -> Vector, Length; disabled
vec2pt_5 = Vector2Pt(PointA=bottom_center_3, PointB=end_4.End, Unitize=rib_height_3)  # -> Vector, Length; disabled
amp_3 = Amplitude(Vector=vec2pt_5.Vector, Amplitude=rib_height_3)  # disabled
vrot_2 = Rotate(Vector=vec2pt_4.Vector, Axis=Z_10, Angle=rad_3)  # disabled
vrot_3 = Rotate(Vector=vec2pt_4.Vector, Axis=Z_10, Angle=rad_3)  # disabled
amp_4 = Amplitude(Vector=vrot_2, Amplitude=expr("-x", material_thickness_3))  # disabled
extr_9 = Extrude(Base=bbx_6.Curves, Direction=amp_3)  # disabled
wires_3 = BrepWireframe(Brep=extr_9, Density=-1)  # disabled
amp_5 = Amplitude(Vector=vrot_3, Amplitude=expr("x/2", material_thickness_3))  # disabled
join_3 = JoinCurves(Curves=wires_3, Preserve=False)  # disabled
move_10 = Move(Geometry=join_3, Motion=amp_5)  # -> Geometry, Transform; disabled

vrot_4 = Rotate(Vector=amp_4, Axis=ln_9, Angle=number_slider)  # disabled

extr_10 = Extrude(Base=move_10.Geometry, Direction=vrot_4)  # disabled
cap_5 = CapHoles(Brep=extr_10)  # disabled

sint = SolidIntersection(BrepsA=flatten, BrepsB=cap_5)  # disabled
vec2pt_6 = Vector2Pt(PointA=bottom_center_3, PointB=end_4.End, Unitize=rib_height_3)  # -> Vector, Length; disabled
amp_6 = Amplitude(Vector=vec2pt_6.Vector, Amplitude=expr("-x", slot_cut_depth_2))  # disabled
move_11 = Move(Geometry=sint, Motion=amp_6)  # -> Geometry, Transform; disabled
flip = FlipMatrix(Data=move_11.Geometry)  # disabled
trim = TrimSolid(Shape=cap_4, Cutters=flip)  # -> flatten(Result); disabled
swatch = ColourSwatch(SwatchColor=RGB(41, 204, 204))  # disabled
trim_2 = TrimSolid(Shape=rulesrf_2, Cutters=flip)  # -> flatten(Result); disabled
preview = CustomPreview(Geometry=trim, Shader=swatch)  # disabled

loft = Loft(Curves=bbx_6.Curves, Options={Adjust=False, Closed=False, LoftEnds=0, LoftSimp=0, LoftType=0, Rebuild=10, Refit=0.01})

vec2pt_7 = Vector2Pt(PointA=bottom_center_3, PointB=end_4.End, Unitize=rib_height_3)  # -> Vector, Length; disabled
sint_2 = SolidIntersection(BrepsA=flatten, BrepsB=cap_5)  # disabled
amp_7 = Amplitude(Vector=vec2pt_7.Vector, Amplitude=slot_cut_depth_2)  # disabled
move_12 = Move(Geometry=sint_2, Motion=amp_7)  # -> Geometry, Transform; disabled
trim_3 = TrimSolid(Shape=join_3, Cutters=move_12.Geometry)  # -> flatten(Result); disabled
trim_4 = TrimSolid(Shape=cap_5, Cutters=move_12.Geometry)  # -> flatten(Result); disabled
swatch_2 = ColourSwatch(SwatchColor=RGB(85, 255, 0))  # disabled
preview_2 = CustomPreview(Geometry=trim_4, Shader=swatch_2)  # disabled

pt_9 = Point(grid_base_point)  # disabled
series_12 = Series(Start=pt_9, Step=y_grid_spacing_2, Count=horizontal_num_2)  # disabled
Y_5 = UnitY(Factor=series_12)  # disabled
move_13 = Move(Geometry=pt_9, Motion=Y_5)  # -> Geometry, Transform; disabled
orient_2 = Orient(Geometry=trim_3, Source=arrpolar.Geometry, Target=move_13.Geometry)  # -> Geometry, Transform; disabled

pt_10 = Point(grid_base_point)  # disabled
series_13 = Series(Start=pt_10, Step=x_grid_spacing_2, Count=horizontal_num_2)  # disabled
X_5 = UnitX(Factor=series_13)  # disabled
move_14 = Move(Geometry=pt_10, Motion=X_5)  # -> Geometry, Transform; disabled
orient_3 = Orient(Geometry=trim_2, Source=z_planes.Geometry, Target=move_14.Geometry)  # -> Geometry, Transform; disabled

# ----
# Boolean difference between
# the moved rib and the
# existing rib
Z_11 = UnitZ(Factor=expr("-x/2", rib_height_2))  # disabled
move_15 = Move(Geometry=cap, Motion=Z_11)  # -> Geometry, Transform; disabled

# ----
# Boolean difference between
# the moved rib and the
# existing rib
Z_12 = UnitZ(Factor=expr("x/2", rib_height_2))  # disabled
move_16 = Move(Geometry=cap_2, Motion=Z_12)  # -> Geometry, Transform; disabled
solid_x_axis_struts = SolidDifference(FirstSet=cap_2, SecondSet=flatten(move_15.Geometry))  # disabled

# ----
# Boolean difference between the
# moved rib and the existing rib
area = Area(Geometry=x_planes.Geometry)  # -> Area, Centroid; disabled
scale_nu = ScaleNU(Geometry=x_planes.Geometry, Plane=area.Centroid, ScaleX=1, ScaleY=1, ScaleZ=rib_height_2)  # -> Geometry, Transform; disabled
x_strut_intersect = BrepBrep(A=scale_nu.Geometry, B=solid_x_axis_struts)  # -> Curves, Points; disabled
closed_x_strut_curves = JoinCurves(Curves=flatten(x_strut_intersect.Curves), Preserve=False)  # disabled

# ----
# Orient x strut curves
# to position on y-axis.
project_x_strut_curves = Orient(Geometry=closed_x_strut_curves, Source=x_planes.Geometry, Target=xy_2)  # -> Geometry, Transform; disabled

solid_y_axis_struts = SolidDifference(FirstSet=cap, SecondSet=flatten(move_16.Geometry))  # disabled

area_2 = Area(Geometry=y_planes.Geometry)  # -> Area, Centroid; disabled
scale_nu_2 = ScaleNU(Geometry=y_planes.Geometry, Plane=area_2.Centroid, ScaleX=1, ScaleY=1, ScaleZ=rib_height_2)  # -> Geometry, Transform; disabled
y_strut_intersect = BrepBrep(A=solid_y_axis_struts, B=scale_nu_2.Geometry)  # -> Curves, Points; disabled
closed_y_strut_curves = JoinCurves(Curves=flatten(y_strut_intersect.Curves), Preserve=False)  # disabled

# ----
# Orient y strut curves
# to position on y-axis.
project_y_strut_curves = Orient(Geometry=closed_y_strut_curves, Source=y_planes.Geometry, Target=xy)  # -> Geometry, Transform; disabled
